# Grasshopper definition PPO model 2.0.gh (Grasshopper 1.0.7)
# plug-ins: HoopSnake, Human, froGH, EleFront, Mesh Pipe

# ---- group: environment loop
groupcolor = CSharpScript(Str="environment", Col=ColourSwatch(SwatchColor=RGB(50, 124, 170)))  # inputs Str: String, Col: Color
# ---------- groupcolor: C# usings ----------
using System.Drawing;
using Grasshopper.Kernel.Special;
# ---------- groupcolor: C# ----------
    GH_Document doc = owner.OnPingDocument();
    if (doc == null)
      return;

    foreach (var obj in doc.Objects)
    {
      GH_Group _group = obj as GH_Group;
      if( _group == null)
        continue;

      if(_group.NickName.Contains(Str))
      {
        _group.Colour = Col;
      }

    }
# ---------- end groupcolor ----------

# ---- group: notes
groupcolor_2 = CSharpScript(Str="notes", Col=ColourSwatch(SwatchColor=RGBA(255, 235, 0, 141)))  # inputs Str: String, Col: Color; same code as groupcolor

# ---- group: agent
groupcolor_3 = CSharpScript(Str="agent", Col=ColourSwatch(SwatchColor=RGBA(32, 255, 255, 150)))  # inputs Str: String, Col: Color; same code as groupcolor

# ---- group: display / obstacles
groupcolor_4 = CSharpScript(Str="obstacles", Col=ColourSwatch(SwatchColor=RGB(164, 189, 74)))  # inputs Str: String, Col: Color; same code as groupcolor

# ---- group: Env
groupcolor_5 = CSharpScript(Str="Env", Col=ColourSwatch(SwatchColor=RGB(255, 205, 0)))  # inputs Str: String, Col: Color; same code as groupcolor

# ---- group: output
# Base voxel space
# In order to use the agent:
# - reset Hoopsnake componet
# - Run "load_model.py"
# -loop Hoopsnake component
groupcolor_6 = CSharpScript(Str="output", Col=ColourSwatch(SwatchColor=RGBA(66, 255, 0, 150)))  # inputs Str: String, Col: Color; same code as groupcolor

# ---- group: bake
groupcolor_7 = CSharpScript(Str="bake", Col=ColourSwatch(SwatchColor=RGB(243, 255, 0)))  # inputs Str: String, Col: Color; same code as groupcolor

# ---- group: data
groupcolor_8 = CSharpScript(Str="data", Col=ColourSwatch(SwatchColor=RGBA(195, 250, 0, 150)))  # inputs Str: String, Col: Color; same code as groupcolor

# ---- group: display / postprocessing
groupcolor_9 = CSharpScript(Str="postprocessing", Col=ColourSwatch(SwatchColor=RGB(174, 156, 255)))  # inputs Str: String, Col: Color; same code as groupcolor

# ---- group: sunhour analysis
groupcolor_10 = CSharpScript(Str="sunhour analysis", Col=ColourSwatch(SwatchColor=RGBA(255, 5, 32, 150)))  # inputs Str: String, Col: Color; same code as groupcolor

# ---- group: display / customizable
groupcolor_11 = CSharpScript(Str="customizable", Col=ColourSwatch(SwatchColor=RGBA(0, 255, 77, 150)))  # inputs Str: String, Col: Color; same code as groupcolor

# ---- group: display
groupcolor_12 = CSharpScript(Str="display", Col=ColourSwatch(SwatchColor=RGBA(255, 0, 170, 150)))  # inputs Str: String, Col: Color; same code as groupcolor

# ---- group: customizable
number_slider = Slider(3, range=0..10)
number_slider_2 = Slider(3, range=0..10)
# Set the voxel dimensions and the voxel space extension
number_slider_3 = Slider(3, range=0..10)

# ---- group: Env / customizable
number_slider_4 = Slider(5, range=0..300)
number_slider_5 = Slider(10, range=0..300)
number_slider_6 = Slider(5, range=0..300)

# ---- group: Env
# Display voxel space
# Construct voxel space
# Define starting position
rectangle = Rectangle(Plane=PlaneXY(0, 0, 0), XSize=number_slider, YSize=number_slider_2, Radius=0)  # -> Rectangle, Length
boxrec = BoxRectangle(Rectangle=rectangle.Rectangle, Height=number_slider_3)

# Set space dimensions
arrbox = BoxArray(Geometry=boxrec, Cell=boxrec, XCount=number_slider_4, YCount=number_slider_5, ZCount=number_slider_6)  # -> Geometry, Transform
multiplication = Multiplication(A=number_slider_4, B=number_slider_5, C=number_slider_6)
num_cells = Panel(multiplication)
debrep = DeconstructBrep(Brep=arrbox.Geometry)  # -> Faces, Edges, Vertices
avr = Average(Input=debrep.Vertices)  # -> flatten(ArithmeticMean)
points = PointList(Points=avr, Size=Slider(0.1, range=0..0.1))

# ---- group: Env / display
previewlw = CustomPreviewLineweights(
    Geometry=debrep.Edges,
    Shader=ColourSwatch(SwatchColor=RGB(46, 46, 46)),
    Thickness=Slider(0.28, range=0..10),
    Absolute=False)
preview = CustomPreview(Geometry=arrbox.Geometry, Material=ColourSwatch(SwatchColor=RGBA(255, 255, 255, 71)))  # disabled

# ----
division = Division(A=number_slider_4, B="2")
panel = Panel("5")

# ---- group: obstacles / D
# Iteration
A = Brep([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])

# ---- group: notes
actions = Panel("""up(z)
down(z)
right
left
up
down
addBox""")
actions_2 = Panel("""1
2
3
4
5
6
7""")

# ---- group: obstacles
# Obstacles
brepsinc = PointInBreps(Brep=A, Point=avr, Strict=False)  # -> Inside, Index
# you can try to test the model with diifferent obstacles referencing your breps and linking the cull pattern with obstacles_cells in the component below
cull = CullPattern(List=avr, CullPattern=brepsinc.Inside)

# ---- group: environment / customizable
# Set the assembly dimensions
number_slider_7 = Slider(100, range=0..1000)

# ----
min = ColourSwatch(SwatchColor=RGB(64, 189, 114))

# ---- group: notes
cell_state = Panel("""0 = empty
1 = not empty""")

# ----
number_slider_8 = Slider(88, range=0..100)  # disabled
X = UnitX(Factor=Slider(100, range=0..100))

# ---- group: environment / customizable
target = Slider(7, range=0..14)

# ---- group: data visualization / customizable
rectangle_height = Slider(51.17, range=1..100)  # disabled
rectangle_width = Slider(2.81, range=0..5)  # disabled

# ---- group: data visualization
panel_2 = Panel("""0
1
2
3
4
5
6
7
8
9
10
11
12
13
14
15""")  # disabled
min_2 = ColourSwatch(SwatchColor=RGB(253, 231, 37))  # disabled
max = ColourSwatch(SwatchColor=RGB(0, 15, 178))  # disabled
min_3 = ColourSwatch(SwatchColor=RGB(255, 0, 0))  # disabled
bnd = Bounds(Numbers=panel_2)  # disabled
merge = Merge(Data1=max, Data2=min_3, Data3=min_2)  # disabled
remap = RemapNumbers(Value=panel_2, Source=bnd, Target=Domain(0, 1))  # -> Mapped, Clipped; disabled
interp = InterpolateData(Data=merge, Parameter=remap.Mapped, Interpolation=2)  # disabled

# ----
pt = Point(Point(-104.5968571, -37.51875771, 0))

# ---- group: Env
lng = ListLength(List=avr)
multiplication_2 = Multiplication(A=number_slider_4, B=number_slider_5)
random = Random(Range=lng, Number=1, Seed=Slider(3, range=0..10))
division_2 = Division(A=multiplication_2, B="2")
int = Integer(division_2)

# ----
addition = Addition(A=int, B=division)

# ---- group: Env (continued)
item = ListItem(List=avr, Index=addition, Wrap=True)

# ---- group: display current position
# Display agent current position
number_slider_9 = Slider(0.37, range=0..4.1)
min_4 = ColourSwatch(SwatchColor=RGB(253, 231, 37))

# ---- group: display newposition
# Display agent new position
number_slider_10 = Slider(0.42, range=-0.01..1.3)

# ---- group: sunhour analysis
# Sun hour analysys
panel_3 = Panel("Bologna")
number_slider_11 = Slider(6, range=0..10)
number_slider_12 = Slider(21, range=0..100)
f_ghfilepath = GHFilePathInfo()  # -> FileName, FilePath
concat = Concatenate(FragmentA=f_ghfilepath.FilePath, FragmentB=panel_3, FragmentC=".epw")
path = FilePath(concat)
analysisperiod = LBAnalysisPeriod(
    start_month=number_slider_11,
    start_day=number_slider_12,
    start_hour=Slider(6, range=0..10),
    end_month=number_slider_11,
    end_day=number_slider_12,
    end_hour=Slider(20, range=0..100))  # -> period, hoys, dates; plug-in component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
importloc = LBImportLocation(epw_file=path)  # -> location; plug-in component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
sunpath = LBSunPath(location=importloc, hoys=analysisperiod.hoys, scale=Slider(4.1051, range=0.0001..11))  # -> report, vectors, altitudes, azimuths, hoys, sun_pts, analemma, daily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; plug-in component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
number_slider_13 = Slider(0, range=0..100)
# Cell state: if you use obstacles, remember to add it as context geometry
number_slider_14 = Slider(9, range=0..10)

# ---- group: display
# Display SunPath
geo = Geometry(sunpath.compass)  # disabled
number_slider_15 = Slider(15, range=1..200)  # disabled
number_slider_16 = Slider(29, range=1..200)  # disabled
pt_2 = Point(sunpath.sun_pts)  # disabled
number_slider_17 = Slider(15, range=1..200)  # disabled
number_slider_18 = Slider(7, range=1..200)  # disabled
number_slider_19 = Slider(15, range=1..200)  # disabled
number_slider_20 = Slider(7, range=1..200)  # disabled
panel_4 = Panel("5")  # disabled
item_2 = ListItem(List=sunpath.daily, Index=panel_4, Wrap=True)  # disabled
crv = Curve(item_2)  # disabled
Y = UnitY(Factor=number_slider_16)  # disabled
X_2 = UnitX(Factor=number_slider_15)  # disabled
Y_2 = UnitY(Factor=number_slider_18)  # disabled
X_3 = UnitX(Factor=number_slider_17)  # disabled
Y_3 = UnitY(Factor=number_slider_20)  # disabled
X_4 = UnitX(Factor=number_slider_19)  # disabled
addition_2 = Addition(A=X_2, B=Y)  # disabled
addition_3 = Addition(A=X_3, B=Y_2)  # disabled
addition_4 = Addition(A=X_4, B=Y_3)  # disabled
number_slider_21 = Slider(2.93, range=-0.01..3.3)  # disabled
move = Move(Geometry=geo, Motion=addition_2)  # -> Geometry, Transform; disabled
move_2 = Move(Geometry=crv, Motion=addition_4)  # -> Geometry, Transform; disabled
move_3 = Move(Geometry=pt_2, Motion=addition_3)  # -> Geometry, Transform; disabled
swatch = ColourSwatch(SwatchColor=RGB(0, 0, 0))  # disabled
swatch_2 = ColourSwatch(SwatchColor=RGB(0, 0, 0))  # disabled
sph = Sphere(Base=move_3.Geometry, Radius=number_slider_21)  # disabled
previewlw_2 = CustomPreviewLineweights(Geometry=move_2.Geometry, Shader=swatch, Absolute=False)  # disabled
swatch_3 = ColourSwatch(SwatchColor=RGB(255, 212, 0))  # disabled
previewlw_3 = CustomPreviewLineweights(Geometry=move.Geometry, Shader=swatch_2, Absolute=False)  # disabled
preview_2 = CustomPreview(Geometry=sph, Material=swatch_3)

# ---- group: environment
# Construct boxes
panel_5 = Panel("2")
division_3 = Division(A=number_slider, B=panel_5)
division_4 = Division(A=number_slider_2, B=panel_5)
division_5 = Division(A=number_slider_3, B=panel_5)
X_5 = UnitX(Factor=expr("-x", division_3))
Y_4 = UnitY(Factor=expr("-x", division_4))
Z = UnitZ(Factor=expr("-x", division_5))
addition_5 = Addition(A=X_5, B=Y_4, C=Z)

# ---- group: data
# Data visualization - Heatmap
min_5 = ColourSwatch(SwatchColor=RGBA(0, 86, 0, 117))
max_2 = ColourSwatch(SwatchColor=RGB(68, 1, 84))
min_6 = ColourSwatch(SwatchColor=RGB(253, 231, 37))
merge_2 = Merge(Data1=max_2, Data2=min, Data3=min_6)

# ---- group: environment / display
X_6 = UnitX(Factor=Slider(76, range=0..100))

# ---- group: display
# Text Display Heatmap domain
xy = XYPlane(Origin=Point(0, 0, 0))  # disabled
number_slider_22 = Slider(2, range=0..100)  # disabled
rotate = Rotate(Geometry=xy, Angle=1.570796327, Plane=PlaneXY(0, 0, 0))  # -> Geometry, Transform; disabled
Y_5 = UnitY(Factor=number_slider_22)  # disabled
X_7 = UnitX(Factor=number_slider_8)  # disabled
number_slider_23 = Slider(1.5, range=0..10)  # disabled
move_4 = Move(Geometry=rotate.Geometry, Motion=Y_5)  # -> Geometry, Transform; disabled
panel_6 = Panel("Heatmap domain")  # disabled
move_5 = Move(Geometry=move_4.Geometry, Motion=X_7)  # -> Geometry, Transform; disabled
swatch_4 = ColourSwatch(SwatchColor=RGB(255, 255, 255))  # disabled

# ---- group: notes
neighbours = Panel("""up(z)
down(z)
right
left
up
down""")
panel_7 = Panel("""0 = empty
1 = full
2 = no neighbour""")

# ---- group: data / display
# Display heatmap
number_slider_24 = Slider(50, range=0..100)
Y_6 = UnitY(Factor=number_slider_24)

# ----
X_8 = UnitX(Factor=number_slider_24)

# ---- group: environment
dom = ConstructDomain(DomainStart=Slider(0, range=0..100), DomainEnd=Slider(15, range=0..100))
dom_2 = ConstructDomain(DomainStart=Slider(0, range=0..100), DomainEnd=Slider(30, range=0..100))

# ----
remap_2 = RemapNumbers(Value=target, Source=dom, Target=dom_2)  # -> Mapped, Clipped
round = Round(Number=remap_2.Mapped)  # -> Nearest, Floor, Ceiling

# ---- group: data visualization / display
# Text display Standard deviation
number_slider_25 = Slider(-13.83, range=-119..111)  # disabled
number_slider_26 = Slider(-21.73, range=-100..101)  # disabled
Y_7 = UnitY(Factor=number_slider_25)  # disabled
swatch_5 = ColourSwatch(SwatchColor=RGB(0, 0, 0))  # disabled

# ---- group: display
# Text Display target slh
xy_2 = XYPlane(Origin=Point(0, 0, 0))
xy_3 = XYPlane(Origin=Point(0, 0, 0))
rotate_2 = Rotate(Geometry=xy_3, Angle=1.570796327, Plane=PlaneXY(0, 0, 0))  # -> Geometry, Transform
rotate_3 = Rotate(Geometry=xy_2, Angle=1.570796327, Plane=PlaneXY(0, 0, 0))  # -> Geometry, Transform
Y_8 = UnitY(Factor=Slider(-6.2, range=-12..4))
Y_9 = UnitY(Factor=Slider(-9.1, range=-12..4))
X_9 = UnitX(Factor=Slider(-95, range=-100..100))
X_10 = UnitX(Factor=Slider(-95, range=-100..100))
move_6 = Move(Geometry=xy_3, Motion=Y_8)  # -> Geometry, Transform
move_7 = Move(Geometry=xy_2, Motion=Y_9)  # -> Geometry, Transform
concat_2 = Concatenate(FragmentA=target, FragmentB="h", JoinSeparator=" ")
move_8 = Move(Geometry=move_6.Geometry, Motion=X_9)  # -> Geometry, Transform
move_9 = Move(Geometry=move_7.Geometry, Motion=X_10)  # -> Geometry, Transform
justified_text = JustifiedText3d(
    Location=move_8.Geometry,
    Text="Target",
    Size=Slider(1.5, range=0..10),
    Color=ColourSwatch(SwatchColor=RGB(0, 0, 0)),
    HorizontalAlignment=1,
    VerticalAlginment=1,
    Font="Konnect",
    UseMeshes=False,
    Bake=False)
justified_text_2 = JustifiedText3d(
    Location=move_9.Geometry,
    Text=concat_2,
    Size=Slider(1.5, range=0..10),
    Color=ColourSwatch(SwatchColor=RGB(0, 0, 0)),
    HorizontalAlignment=1,
    VerticalAlginment=1,
    Font="Konnect",
    UseMeshes=False,
    Bake=False)
pt_3 = Point(Point(-102.0772846, -4.193945432, 0))

number_slider_27 = Slider(1.3, range=1..20)
rectangle_2 = Rectangle(Plane=pt_3, XSize=Slider(15, range=1..20), YSize=number_slider_27, Radius=0)  # -> Rectangle, Length
rectangle_3 = Rectangle(Plane=pt_3, XSize=target, YSize=number_slider_27, Radius=0)  # -> Rectangle, Length
gradient = Gradient(LowerLimit="0", UpperLimit="15", Parameter=target, stops=[0.404: RGB(255, 99, 71), 0.528: RGB(128, 255, 128)])
boundary = BoundarySurfaces(Edges=rectangle_2.Rectangle)
Y_10 = UnitY(Factor=Slider(-7.84, range=-11..20))
move_10 = Move(Geometry=rectangle_3.Rectangle, Motion=Y_10)  # -> Geometry, Transform
boundary_2 = BoundarySurfaces(Edges=move_10.Geometry)
move_11 = Move(Geometry=boundary, Motion=Y_10)  # -> Geometry, Transform
debrep_2 = DeconstructBrep(Brep=boundary_2)  # -> Faces, Edges, Vertices
debrep_3 = DeconstructBrep(Brep=move_11.Geometry)  # -> Faces, Edges, Vertices
preview_3 = CustomPreview(Geometry=debrep_2.Faces, Material=gradient)
preview_4 = CustomPreview(Geometry=debrep_3.Faces, Material=ColourSwatch(SwatchColor=RGB(171, 171, 171)))

# Text Display Slh
xy_4 = XYPlane(Origin=Point(0, 0, 0))
xy_5 = XYPlane(Origin=Point(0, 0, 0))
rotate_4 = Rotate(Geometry=xy_4, Angle=1.570796327, Plane=PlaneXY(0, 0, 0))  # -> Geometry, Transform
rotate_5 = Rotate(Geometry=xy_5, Angle=1.570796327, Plane=PlaneXY(0, 0, 0))  # -> Geometry, Transform
Y_11 = UnitY(Factor=Slider(2.3, range=-12..4))
Y_12 = UnitY(Factor=Slider(-1.3, range=-12..4))
X_11 = UnitX(Factor=Slider(-95, range=-100..100))
X_12 = UnitX(Factor=Slider(-95, range=-100..100))
move_12 = Move(Geometry=xy_4, Motion=Y_11)  # -> Geometry, Transform
move_13 = Move(Geometry=xy_5, Motion=Y_12)  # -> Geometry, Transform
move_14 = Move(Geometry=move_12.Geometry, Motion=X_11)  # -> Geometry, Transform
move_15 = Move(Geometry=move_13.Geometry, Motion=X_12)  # -> Geometry, Transform
justified_text_3 = JustifiedText3d(
    Location=move_14.Geometry,
    Text="Sunlight hours",
    Size=Slider(1.5, range=0..10),
    Color=ColourSwatch(SwatchColor=RGB(0, 0, 0)),
    HorizontalAlignment=1,
    VerticalAlginment=1,
    Font="Konnect",
    UseMeshes=False,
    Bake=False)

# ---- group: data visualization
# Calculate standard deviation
panel_8 = Panel("2")  # disabled
panel_9 = Panel("0.5")  # disabled

# Calculate surrounding index
panel_10 = Panel("0")  # disabled
panel_11 = Panel("1")  # disabled

number_slider_28 = Slider(1, range=0..1)  # disabled
number_slider_29 = Slider(0, range=0..1)  # disabled
dom_3 = ConstructDomain(DomainStart=number_slider_29, DomainEnd=number_slider_28)  # disabled

# Data visualization - graph & KPI
# Calculate density index
X_13 = UnitX(Factor=expr("-x", number_slider_26))  # disabled
number_slider_30 = Slider(2.44, range=1..5)  # disabled
panel_12 = Panel("σ")  # disabled
number_slider_31 = Slider(2.44, range=1..5)  # disabled
panel_13 = Panel("Sun hours")  # disabled
panel_14 = Panel("h")  # disabled
concat_3 = Concatenate(FragmentA=panel_2, FragmentB=panel_14)  # disabled
panel_15 = Panel("""0%
10%
20%
30%
40%
50%
60%
70%
80%
90%
100%""")  # disabled
panel_16 = Panel("surfaces %")  # disabled
panel_17 = Panel("sun hours")  # disabled
panel_18 = Panel("1")  # disabled

# ---- group: data visualization / display (continued)
addition_6 = Addition(A=Y_7, B=X_13)  # disabled

# ---- group: data visualization
# Calcuate footprint
multiplication_3 = Multiplication(A=number_slider, B=number_slider_2)  # disabled

# Ground Area
multiplication_4 = Multiplication(A=multiplication_3, B=number_slider_4, C=number_slider_5)  # disabled

# ---- group: data visualization / display
# Text display number of possible vertical connection cells
number_slider_32 = Slider(-22.31, range=-119..111)  # disabled
number_slider_33 = Slider(-17.06, range=-100..101)  # disabled
Y_13 = UnitY(Factor=number_slider_32)  # disabled
X_14 = UnitX(Factor=expr("-x", number_slider_33))  # disabled
addition_7 = Addition(A=Y_13, B=X_14)  # disabled
panel_19 = Panel("density factor")  # disabled
number_slider_34 = Slider(1.55, range=1..5)  # disabled
swatch_6 = ColourSwatch(SwatchColor=RGB(0, 0, 0))  # disabled

# Text display SUNHOURS
number_slider_35 = Slider(-8.31, range=-119..111)  # disabled
number_slider_36 = Slider(-13.83, range=-100..101)  # disabled
Y_14 = UnitY(Factor=number_slider_35)  # disabled
swatch_7 = ColourSwatch(SwatchColor=RGB(0, 0, 0))  # disabled

# ---- group: data visualization (continued)
X_15 = UnitX(Factor=expr("-x", number_slider_36))  # disabled

# ---- group: display
number_slider_37 = Slider(1.3, range=1..20)
pt_4 = Point(Point(-102.0772846, -4.193945432, 0))
rectangle_4 = Rectangle(Plane=pt_4, XSize=Slider(15, range=1..20), YSize=number_slider_37, Radius=0)  # -> Rectangle, Length
boundary_3 = BoundarySurfaces(Edges=rectangle_4.Rectangle)
debrep_4 = DeconstructBrep(Brep=boundary_3)  # -> Faces, Edges, Vertices
preview_5 = CustomPreview(Geometry=debrep_4.Faces, Material=ColourSwatch(SwatchColor=RGB(171, 171, 171)))

# ---- group: data visualization / display (continued)
addition_8 = Addition(A=Y_14, B=X_15)  # disabled

# ---- group: data visualization
panel_20 = Panel("10")  # disabled
division_6 = Division(A=rectangle_height, B=panel_20)  # disabled
Y_15 = UnitY(Factor=division_6)  # disabled
pt_5 = Point(Point(0, 0, 0))  # disabled
panel_21 = Panel("11")  # disabled
arrlinear = LinearArray(Geometry=pt_5, Direction=Y_15, Count=panel_21)  # -> Geometry, Transform; disabled

number_slider_38 = Slider(3.48, range=0..100)  # disabled
number_slider_39 = Slider(-97.56, range=-106..100)  # disabled
X_16 = UnitX(Factor=number_slider_38)  # disabled
X_17 = UnitX(Factor=rectangle_width)  # disabled
pt_6 = Point(Point(0, 0, 0))  # disabled
panel_22 = Panel("16")  # disabled
arrlinear_2 = LinearArray(Geometry=pt_6, Direction=X_16, Count=panel_22)  # -> Geometry, Transform; disabled
X_18 = UnitX(Factor=number_slider_39)  # disabled
move_16 = Move(Geometry=arrlinear_2.Geometry, Motion=X_18)  # -> Geometry, Transform; disabled

move_17 = Move(Geometry=arrlinear.Geometry, Motion=X_18)  # -> Geometry, Transform; disabled

number_slider_40 = Slider(0.92, range=0..1)  # disabled
number_slider_41 = Slider(1.98, range=0..3)  # disabled
Y_16 = UnitY(Factor=expr("-x", number_slider_41))  # disabled
X_19 = UnitX(Factor=number_slider_40)  # disabled
addition_9 = Addition(A=X_19, B=Y_16)  # disabled
move_18 = Move(Geometry=move_16.Geometry, Motion=addition_9)  # -> Geometry, Transform; disabled
swatch_8 = ColourSwatch(SwatchColor=RGB(0, 0, 0))  # disabled
panel_23 = Panel("1")  # disabled

number_slider_42 = Slider(5.06, range=0..11)  # disabled
X_20 = UnitX(Factor=expr("-x", number_slider_42))  # disabled
move_19 = Move(Geometry=move_17.Geometry, Motion=X_20)  # -> Geometry, Transform; disabled
swatch_9 = ColourSwatch(SwatchColor=RGB(0, 0, 0))  # disabled
panel_24 = Panel("1")  # disabled

number_slider_43 = Slider(2, range=0..3)  # disabled
number_slider_44 = Slider(57.63, range=0..101)  # disabled
Y_17 = UnitY(Factor=expr("-x", number_slider_43))  # disabled
X_21 = UnitX(Factor=number_slider_44)  # disabled
addition_10 = Addition(A=X_21, B=Y_17)  # disabled
item_3 = ListItem(List=move_16.Geometry, Index=0, Wrap=True)  # disabled
swatch_10 = ColourSwatch(SwatchColor=RGB(0, 0, 0))  # disabled
move_20 = Move(Geometry=item_3, Motion=addition_10)  # -> Geometry, Transform; disabled

# ---- group: data visualization / display
tag = TextTag3D(Location=move_18.Geometry, Text=concat_3, Size=panel_23, Colour=swatch_8, Justification=7)  # disabled

tag_2 = TextTag3D(Location=move_19.Geometry, Text=panel_15, Size=panel_24, Colour=swatch_9, Justification=7)  # disabled

item_4 = ListItem(List=move_17.Geometry, Index=0, Wrap=True)  # disabled
move_21 = Move(Geometry=item_4, Motion=addition_6)  # -> Geometry, Transform; disabled

item_5 = ListItem(List=move_17.Geometry, Index=0, Wrap=True)  # disabled
move_22 = Move(Geometry=item_5, Motion=addition_7)  # -> Geometry, Transform; disabled

item_6 = ListItem(List=move_17.Geometry, Index=0, Wrap=True)  # disabled
move_23 = Move(Geometry=item_6, Motion=addition_8)  # -> Geometry, Transform; disabled

# ---- group: display
# Text Display blocks placed
xy_6 = XYPlane(Origin=Point(0, 0, 0))
rotate_6 = Rotate(Geometry=xy_6, Angle=1.570796327, Plane=PlaneXY(0, 0, 0))  # -> Geometry, Transform
Y_18 = UnitY(Factor=Slider(20, range=0..100))
move_24 = Move(Geometry=rotate_6.Geometry, Motion=Y_18)  # -> Geometry, Transform
X_22 = UnitX(Factor=1)
move_25 = Move(Geometry=move_24.Geometry, Motion=X_22)  # -> Geometry, Transform

# Text Display reward
xy_7 = XYPlane(Origin=Point(0, 0, 0))
rotate_7 = Rotate(Geometry=xy_7, Angle=1.570796327, Plane=PlaneXY(0, 0, 0))  # -> Geometry, Transform
Y_19 = UnitY(Factor=Slider(2.9, range=-12..4))
X_23 = UnitX(Factor=Slider(42, range=0..100))
move_26 = Move(Geometry=rotate_7.Geometry, Motion=Y_19)  # -> Geometry, Transform
move_27 = Move(Geometry=move_26.Geometry, Motion=X_23)  # -> Geometry, Transform
pt_7 = Point(Point(-95.61767166, -27.03581767, 0))

# ---- group: bake
# baking for post processing
panel_25 = Panel("2")
division_7 = Division(A=number_slider, B=panel_25)
division_8 = Division(A=number_slider_2, B=panel_25)
division_9 = Division(A=number_slider_3, B=panel_25)

# ---- group: display
# Text Display observation
number_slider_45 = Slider(0.9, range=0..10)
pt_8 = Point([Point(-102.0499617, -22.34685858, 0), Point(-98.04996169, -22.34685858, 0), Point(-100.0499617, -22.34685858, 0), Point(-94.04996169, -22.34685858, 0), Point(-92.04996169, -22.34685858, 0), Point(-96.04996169, -22.34685858, 0), Point(-88.04996169, -22.34685858, 0), Point(-90.04996169, -22.34685858, 0)])
pt_9 = Point(Point(-95.41993585, -19.01338138, 0))
# Display cells with an
# upper neighbour
justified_text_4 = JustifiedText3d(
    Location=pt_9,
    Text="Observations",
    Size=Slider(1.5, range=0..10),
    Color=ColourSwatch(SwatchColor=RGB(0, 0, 0)),
    HorizontalAlignment=1,
    VerticalAlginment=1,
    Font="Konnect",
    UseMeshes=False,
    Bake=False)

# Text Display reward
number_slider_46 = Slider(1.5, range=0..10)
pt_10 = Point(Point(-95.61767166, -27.03581767, 0))
justified_text_5 = JustifiedText3d(
    Location=pt_10,
    Text="Reward",
    Size=number_slider_46,
    Color=ColourSwatch(SwatchColor=RGB(0, 0, 0)),
    HorizontalAlignment=1,
    VerticalAlginment=1,
    Font="Konnect",
    UseMeshes=False,
    Bake=False)
pt_11 = Point(Point(-95.80373316, -29.41916147, 0))

# ---- group: data visualization
number_slider_47 = Slider(55.82, range=0..111)  # disabled
number_slider_48 = Slider(7.01, range=0..101)  # disabled
Y_20 = UnitY(Factor=number_slider_47)  # disabled
item_7 = ListItem(List=move_17.Geometry, Index=0, Wrap=True)  # disabled
swatch_11 = ColourSwatch(SwatchColor=RGB(0, 0, 0))  # disabled
panel_26 = Panel("1")  # disabled

xy_8 = XYPlane(Origin=Point(0, 0, 0))  # disabled

X_24 = UnitX(Factor=expr("-x", number_slider_48))  # disabled
# Text display number of possible vertical connection cells
display = TextTag3D(Location=move_20.Geometry, Text=panel_17, Size=panel_18, Colour=swatch_10, Justification=7)  # disabled

addition_11 = Addition(A=Y_20, B=X_24)  # disabled
move_28 = Move(Geometry=item_7, Motion=addition_11)  # -> Geometry, Transform; disabled

# ---- group: data visualization / display
tag_3 = TextTag3D(Location=move_28.Geometry, Text=panel_16, Size=panel_26, Colour=swatch_11, Justification=7)  # disabled

# ---- group: agent
enable = GhPythonScript(iter=hs.IterationsCounter)  # -> enabled
# ---------- enable: Python ----------
__author__ = "boris"
__version__ = "2020.08.28"

import rhinoscriptsyntax as rs
import scriptcontext as sc

enabled = True
if sc.sticky["enabled"] is not None:
    enabled = sc.sticky["enabled"]
# ---------- end enable ----------
hs = HoopSnake(
    StartingData=item,
    Data=environment.newposition,
    TerminationCondition=enable,
    Hoopsnake_Data_autoUpdate=False,
    Hoopsnake_Data_dataLimit=2147483647,
    Hoopsnake_Data_delay=0,
    Hoopsnake_Data_resetCounter=True,
    Hoopsnake_Data_updateView=True)  # -> Feedback, CumulativeFeedback, LoopsCounter, IterationsCounter
panel_27 = Panel(hs.IterationsCounter)

# ---- group: display current position (continued)
pt_12 = Point(hs.Feedback)
sph_2 = Sphere(Base=pt_12, Radius=number_slider_9)
preview_6 = CustomPreview(Geometry=sph_2, Material=min_4)  # disabled

# ---- group: agent
# Recieve action
# Agent: Sends observation message and receives action message
agent = GhPythonScript(iter=hs.IterationsCounter)  # -> action, reset
# ---------- agent: Python ----------
__author__ = "boris + AE"
__version__ = "2020.08.24"

# updated to use Gymnasium environments - AE

import rhinoscriptsyntax as rs
import scriptcontext as sc

import socket
import struct
import pickle

class Connection:
    def __init__(self, s):
        self._socket = s
        self._buffer = ""

    def receive_object(self):
        while len(self._buffer) < 4 or len(self._buffer) < struct.unpack("<L", self._buffer[:4])[0] + 4:
            new_bytes = self._socket.recv(16)
            if len(new_bytes) == 0:
                return None
            self._buffer += new_bytes
        length = struct.unpack("<L", self._buffer[:4])[0]
        header, body = self._buffer[:4], self._buffer[4:length + 4]
        obj = pickle.loads(body)
        self._buffer = self._buffer[length + 4:]
        return obj

    def send_object(self, d):
        body = pickle.dumps(d)
        header = struct.pack("<L", len(body))
        msg = header + body
        self._socket.send(msg)


# Connection
if iter == 0:
    addr = ("127.0.0.1", 50710)
    agent_socket = socket.socket(socket.AF_INET, socket.SOCK_STREAM)
    agent_socket.connect(addr)
    agent_conn = Connection(agent_socket)
    # Reset
    msg_in = agent_conn.receive_object()
    if msg_in == "reset":
        reset = True
        sc.sticky["enabled"] = True
    else:
        raise RuntimeError("First message must be 'reset'")
else:
    # Send message
    msg_out = {"observation": sc.sticky["observation"],
               "reward": sc.sticky["reward"],
               "terminated": sc.sticky["terminated"],
               "truncated": sc.sticky["truncated"],
               "info": sc.sticky["info"],
               "initial_reward": sc.sticky["initial_reward"],}
    agent_conn.send_object(msg_out)
    # Receive message
    msg_in = agent_conn.receive_object()
    if msg_in == "reset":
        reset = True
    elif msg_in == "close":
        reset = True
        agent_socket.close()
        sc.sticky["enabled"] = False
    else:
        action = msg_in
# ---------- end agent ----------

# ----
panel_28 = Panel(agent.action)
panel_29 = Panel(agent.reset)

# ---- group: environment
# Step action
# Environment: computes observation and updates sticky variables
item_8 = ListItem(List=actions_2, Index=agent.action, Wrap=True)
environment = GhPythonScript(
    action=item_8,
    currentposition=hs.Feedback,
    positions=avr,
    x_count=number_slider_4,
    y_count=number_slider_5,
    z_count=number_slider_6,
    num_cells=multiplication,
    boxestoadd=number_slider_7,
    reset=agent.reset)  # -> cell_state, agentposition, reward, done, truncated, info, currentposition_state, newposition, lastbox; inputs action: Int32, currentposition: Point3d, positions: list of Point3d, num_cells: Int32, obstacle_cells: list of Point3d
# ---------- environment: Python ----------
import rhinoscriptsyntax as rs
import scriptcontext as sc
import Rhino.Geometry as rg



class Env:
    def __init__(self,positions, currentposition, x_count,y_count,z_count,num_cells,boxestoadd):
        self.num_cells = num_cells
        self.action_space = {"space_type": "Discrete", "n": [7]}
        self.observation_space = {"space_type": "MultiDiscrete", "nvec": [3] * 6 + [30]*2}
        self._state = [0]*self.num_cells
        self._iter = 0
        self.boxestoadd = boxestoadd
        self.positions = positions
        self.currentposition = currentposition
        self.x_count = int(x_count)
        self.y_count = int(y_count)
        self.z_count = int(z_count)
        self.newposition = None
        self.numberofboxes = 0
        
    def step(self, u):
        self._state = self._get_obs()
        print(self._state)
        #agent position in possible positionslist
        currentindex = positions.index(currentposition)
        #cost = 0.1
        currentposition_state = self._state[currentindex]
        print(u)
        print(currentindex)
        
    #take action
        if u == 1:
            print("up(z)")
            if currentindex >= len(self.positions)-(self.x_count*self.y_count):
                self.newposition = self.positions[int(currentindex)]
            else:
                self.newposition = self.positions[int(currentindex + (x_count* y_count))]
            #cost -= 0.1
        elif u ==2:
            print("down(z)")
            if currentindex <= (self.x_count*self.y_count):
                self.newposition = self.positions[int(currentindex)]
            else:
                self.newposition = self.positions[int(currentindex - (x_count* y_count))]
            #cost -= 0.1
        elif u == 3:
            print ("right")
            if currentindex%x_count == x_count-1:
                self.newposition = self.positions[int(currentindex)]
            else:
                self.newposition = self.positions[int(currentindex +1)]
            #cost -= 0.1
        elif u == 4:
            print ("left")
            if currentindex%x_count == 0:
                self.newposition = self.positions[int(currentindex)]
            else:
                self.newposition = self.positions[int(currentindex -1)]
            #cost -= 0.1
        elif u == 5:
            print ("up")
            if currentindex%(x_count*y_count) >= (self.x_count*self.y_count)-self.x_count:
               self.newposition = self.positions[int(currentindex)]
            else:
               self.newposition = self.positions[int(currentindex + self.x_count)]
            #cost -= 0.1
        elif u == 6:
            print ("down")
            if currentindex%(x_count*y_count) <= self.x_count-1:
                self.newposition = self.positions[int(currentindex)]
            else:
                self.newposition =self.positions[int(currentindex - self.x_count)]
            #cost -= 0.1
            
        elif u == 7 and currentposition not in obstacle_cells:
            print ("addbox")
            self.newposition = self.positions[int(currentindex)]
            
        #update state
            if self._state[currentindex]== 0:
               self._state[currentindex] += 1
            elif self._state[currentindex]== 1:
              pass
            elif self._state[currentindex]== 2:
              pass
        #reward by structure
            
                
        else:
            print ("noaction")
            pass
        
        
        print(self.newposition)
        print(self._state)
        
        done = False
        truncated = False
        lastbox = False
        numberofboxes = sum(self._state)
        agentposition = positions.index(self.newposition)
        self._iter += 1
        if int(numberofboxes) == int(boxestoadd):
           #cost += 1000
           self._iter = 0
           done = True
           lastbox = True
        return self._get_obs(), done, truncated, {},self.newposition, numberofboxes, agentposition, lastbox, currentposition_state
        
    
        
    def reset(self):
        self._iter = 0
        agentposition = positions.index(currentposition)
        self._state = [0]*self.num_cells
        return self._get_obs(), agentposition
    
    def _get_obs(self):
        cell_state = self._state
        return cell_state
        
        
    
if "env" not in globals():
    env = Env(positions, currentposition, x_count,y_count,z_count, num_cells,boxestoadd)

if reset:
    cell_state, agentposition = env.reset()
    
    info = {
        "action_space": "gym.spaces.Discrete(7)",
        "observation_space": "gym.spaces.MultiDiscrete([3]*6 + [30]*2)"
    }
elif action:
    cell_state, done, truncated, info, newposition, numberofboxes, agentposition, lastbox, currentposition_state = env.step(action)
    print (cell_state, done, truncated, info)
else:
    raise RuntimeError("Either reset or action must be provided")



sc.sticky["truncated"] = truncated
sc.sticky["info"] = info

if done:
    sc.sticky["cell_state"] = cell_state
# ---------- end environment ----------

# ---- group: data (continued)
pt_13 = Point(flatten(hs.CumulativeFeedback))
cset = CreateSet(List=pt_13)  # -> Set, Map
cset_2 = CreateSet(List=cset.Map)  # -> Set, Map
mindex = MemberIndex(Set=cset.Map, Member=cset_2.Set)  # -> Index, Count
bnd_2 = Bounds(Numbers=mindex.Count)
remap_3 = RemapNumbers(Value=mindex.Count, Source=bnd_2, Target=Domain(0, 1))  # -> Mapped, Clipped
graph = GraphMapper(
    remap_3.Mapped,
    x0=0,
    x1=1,
    y0=0,
    y1=1,
    container_name="Bezier",
    cpx=[0, 0.006851859856, 0.537201345, 1],
    cpy=[0.0158983469, 0.9327710867, 1, 1])
interp_2 = InterpolateData(Data=merge_2, Parameter=graph, Interpolation=2)

# ---- group: environment (continued)
python = GhPythonScript(observation=environment.cell_state)  # -> notemptycells; inputs observation: list of Int32
# ---------- python: Python ----------
__author__ = "giuse"
__version__ = "2023.11.12"

import rhinoscriptsyntax as rs

notemptycells = []

for index, cell in enumerate(observation):
    if cell >= 1:
        notemptycells.append(index)
    else:
        pass
# ---------- end python ----------
item_9 = ListItem(List=avr, Index=python, Wrap=True)  # -> graft(Item)
move_29 = Move(Geometry=item_9, Motion=addition_5)  # -> flatten(Geometry), Transform
voxel = Voxel(Points=move_29.Geometry, X=number_slider, Y=number_slider_2, Z=number_slider_3)
f_mrenorm = MeshRebuildNormals(Mesh=voxel)
unweld = UnweldMesh(Mesh=f_mrenorm, Angle=1.570796327)

# ---- group: output
newposition = Panel(environment.newposition)
truncated = Panel(environment.truncated)
done = Panel(environment.done)
cells_state = Panel(environment.cell_state)

# ---- group: display newposition (continued)
# Output 1 - step action, construct blocks
pt_14 = Point(environment.newposition)  # disabled
sph_3 = Sphere(Base=pt_14, Radius=number_slider_10)
preview_7 = CustomPreview(Geometry=sph_3, Material=ColourSwatch(SwatchColor=RGB(255, 0, 0)))  # disabled

# ---- group: environment / display (continued)
move_30 = Move(Geometry=unweld, Motion=X_6)  # -> Geometry, Transform
preview_8 = CustomPreview(Geometry=move_30.Geometry, Material=ColourSwatch(SwatchColor=RGB(255, 255, 255)))

# ---- group: environment
# compute initial_reward by neighbours
python_2 = GhPythonScript(
    cell_state=environment.cell_state,
    agentposition=environment.agentposition,
    num_cells=multiplication,
    x_count=number_slider_4,
    y_count=number_slider_5,
    z_count=number_slider_6,
    done=environment.done,
    action=agent.action)  # -> neighbours, neighbours_state, terminated; inputs cell_state: list, done: Boolean
# ---------- python_2: Python ----------
__author__ = "giuse"
__version__ = "2023.12.08"

import rhinoscriptsyntax as rs
import scriptcontext as sc


#find neighbours
neighbours = []

 # neighbour up(z)
if agentposition >= num_cells - (x_count*y_count):
     neighbours.append(0)
else:
     neighbours.append((int(agentposition + (x_count*y_count))))

# neighbour down(z)
if agentposition <= (x_count * y_count):
    neighbours.append(0)
else:
    neighbours.append(int(agentposition - (x_count*y_count)))

# neighbour right
if agentposition % x_count == x_count-1:
    neighbours.append(0)
else:
    neighbours.append(int(agentposition + 1))

# neighbour left
if agentposition % x_count == 0:
    neighbours.append(0)
else:
    neighbours.append(int(agentposition - 1))

# neighbour up
if agentposition %(x_count*y_count) >= (x_count*y_count)-x_count:
    neighbours.append(0)
else:
    neighbours.append(int(agentposition + x_count))
    
# neighbour down
if agentposition % (x_count*y_count) <= x_count-1:
    neighbours.append(0)
else:
    neighbours.append(int(agentposition - x_count))
    




#create neighbour state list
neighbours_state = []

# neigbour up(z) state
if neighbours[0] == 0:
    neighbours_state.append(2)
else:
    neighbours_state.append(cell_state[neighbours[0]])

# neigbour up(z) state
if neighbours[1] == 0:
    neighbours_state.append(2)
else:
    neighbours_state.append(cell_state[neighbours[1]])

# neigbour right state
if neighbours[2] == 0:
    neighbours_state.append(2)
else:
    neighbours_state.append(cell_state[neighbours[2]])

# neigbour left state
if neighbours[3] == 0:
    neighbours_state.append(2)
else:
    neighbours_state.append(cell_state[neighbours[3]])

# neigbour up state
if neighbours[4] == 0:
    neighbours_state.append(2)
else:
    neighbours_state.append(cell_state[neighbours[4]])

# neigbour downstate
if neighbours[5] == 0:
    neighbours_state.append(2)
else:
    neighbours_state.append(cell_state[neighbours[5]])



#game over condition
terminated = done


sc.sticky["terminated"] = terminated
# ---------- end python_2 ----------
# Check neighbours's state to verify the adiacence condition and compute reward
python_3 = GhPythonScript(
    neighbours_state=python_2.neighbours_state,
    currentposition_state=environment.currentposition_state,
    new_position=environment.newposition,
    obstacles_cells=cull,
    action=agent.action)  # -> initial_reward; inputs neighbours_state: list, new_position: Point3d, obstacles_cells: list of Point3d
# ---------- python_3: Python ----------
__author__ = "giuse"
__version__ = "2023.12.01"
        
import rhinoscriptsyntax as rs
import Rhino.Geometry as rg
import scriptcontext as sc
        
initial_reward = 0
        
#compute reward checking the adiacence
if neighbours_state is not None:
    if action == 6 and currentposition_state == 0 and new_position not in obstacles_cells:
        if 1 in neighbours_state:
            initial_reward += 5
        #for state in neighbours_state:
            #if state == 1:
                #initial_reward += 5
                
            
        
       
        #reward/punishment for down connection
        #if neighbours_state[1] == "null":
            #initial_reward += 5
        
                    
        
                
print(initial_reward)
sc.sticky["initial_reward"] = initial_reward
# ---------- end python_3 ----------

# ---- group: bake
bake = BakeObjects(Geometry=unweld, Bake=python_2.terminated)

# ---- group: data / display (continued)
box = CenterBox(Base=cset.Set, X=division_3, Y=division_4, Z=division_5)
move_31 = Move(Geometry=box, Motion=X_8)  # -> Geometry, Transform
preview_9 = CustomPreview(Geometry=move_31.Geometry, Material=interp_2)
dots = DotDisplay(Point=cset.Set, Colour=interp_2, Size=Slider(0.21, range=0..30.01))

# ----
item_10 = ListItem(List=arrbox.Geometry, Index=python_2.neighbours, Wrap=True)

# ---- group: notes (continued)
neighbours_2 = Panel(python_2.neighbours)
neighbour_state = Panel(python_2.neighbours_state)

# ---- group: display (continued)
concat_4 = Concatenate(FragmentA=panel_6, FragmentB=bnd_2, JoinSeparator="=")  # disabled
tag_4 = TextTag3D(Location=move_5.Geometry, Text=concat_4, Size=number_slider_23, Colour=swatch_4, Justification=7)  # disabled

# ---- group: initial reward
# Output 2 - compute obs & reward
panel_30 = Panel(python_3)

# ---- group: bake (continued)
python_4 = GhPythonScript(observation=environment.cell_state)  # -> notemptycells; inputs observation: list of Int32; same code as python
item_11 = ListItem(List=avr, Index=python_4, Wrap=True)  # -> graft(Item)
box_2 = CenterBox(Base=item_11, X=division_7, Y=division_8, Z=division_9)

# ---- group: display (continued)
ma = MassAddition(Input=flatten(environment.cell_state))  # -> Result, PartialResults
concat_5 = Concatenate(FragmentA="blocks placed", FragmentB=ma.Result, JoinSeparator="=")
tag_5 = TextTag3D(
    Location=pt,
    Text=concat_5,
    Size=Slider(1.5, range=0..10),
    Colour=ColourSwatch(SwatchColor=RGB(0, 0, 0)),
    Justification=7)

# ---- group: bake / display
preview_10 = CustomPreview(Geometry=box_2, Material=ColourSwatch(SwatchColor=RGB(255, 255, 255)))  # disabled

# ---- group: bake
bake_2 = BakeObjects(Geometry=box_2, Bake=python_2.terminated)

# ---- group: sunhour analysis (continued)
directsunhours = LBDirectSunHours(
    vectors=flatten(sunpath.vectors),
    geometry=flatten(unweld),
    context=flatten(unweld),
    grid_size=number_slider_14,
    offset_dist=Slider(0.1, range=0.01..1),
    run=Toggle(True))  # -> report, points, results, mesh, legend, title, int_mtx; plug-in component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

# ----
pdecon = Deconstruct(Point=directsunhours.points)  # -> XComponent, YComponent, ZComponent
mesh = Mesh(directsunhours.mesh)
move_32 = Move(Geometry=mesh, Motion=X)  # -> Geometry, Transform
larger = LargerThan(FirstNumber=pdecon.ZComponent, SecondNumber="0")  # -> LargerThan, OrEqualTo
cull_2 = CullPattern(List=directsunhours.results, CullPattern=larger.LargerThan)

# ---- group: sunhour analysis (continued)
avr_2 = Average(Input=cull_2)
num = Number(expr("round(x,2)", avr_2))

# ---- group: data visualization (continued)
data = Data(cull_2)  # disabled
subtraction = Subtraction(A=data, B=num)  # disabled
lng_2 = ListLength(List=data)  # disabled
pow = Power(A=subtraction, B=panel_8)  # disabled
ma_2 = MassAddition(Input=pow)  # -> Result, PartialResults; disabled
division_10 = Division(A=ma_2.Result, B=lng_2)  # disabled
pow_2 = Power(A=division_10, B=panel_9)  # disabled

volume = Volume(Geometry=directsunhours.mesh)  # -> Volume, Centroid; disabled
area = Area(Geometry=directsunhours.mesh)  # -> Area, Centroid; disabled
division_11 = Division(A=volume.Volume, B=area.Area)  # disabled

# ---- group: environment (continued)
remap_4 = RemapNumbers(Value=num, Source=dom, Target=dom_2)  # -> Mapped, Clipped

# compute obs & reward
round_2 = Round(Number=remap_4.Mapped)  # -> Nearest, Floor, Ceiling
python_5 = GhPythonScript(
    results=round_2.Nearest,
    target=round.Nearest,
    action=agent.action,
    cell_state=environment.cell_state,
    agentposition=environment.agentposition,
    neighbours=python_2.neighbours,
    neighbours_state=python_2.neighbours_state,
    currentposition_state=environment.currentposition_state,
    lastbox=environment.lastbox,
    new_position=environment.newposition,
    obstacles_cells=cull,
    initial_reward=python_3,
    boxestoadd=number_slider_7)  # -> reward, observation; inputs results: Int32, target: Int32, action: Int32, cell_state: list of Int32, neighbours: list, neighbours_state: list of Int32, lastbox: Int32, new_position: Point3d, obstacles_cells: list of Point3d
# ---------- python_5: Python ----------
__author__ = "giuse"
__version__ = "2023.11.19"

import rhinoscriptsyntax as rs
import scriptcontext as sc

#initialize analysis result as target for the first itersation
analysis_result = target


#compute observation
if results is not None:
    analysis_result = results
else:
    pass
    
if agentposition is None:
    raise RuntimeError("agentposition is None")

if cell_state is None:
    raise RuntimeError("cell_state is None")

if analysis_result is None:
    raise RuntimeError("analysis_result is None")
    
observation = neighbours_state + [analysis_result, target]

#compute reward
reward = 0
if action == 6 and currentposition_state == 0 and new_position not in obstacles_cells:
    scostamento = abs(target - results)
    if scostamento <= 1:
        reward += 10
    elif 1 < scostamento <= 2:
        reward += 5
    #elif 2 < abs(target - results)<= 4:
        #reward -= 5
    #elif abs(target - results)> 4:
        #reward -= 10
else:
    pass

if lastbox:
    print (results)
    if results >= (target-1) and results <= (target+1):
      reward += 1000      
    else:
      reward -= 10
reward += initial_reward

sc.sticky["observation"] = observation
sc.sticky["reward"] = reward
# ---------- end python_5 ----------

# ---- group: display (continued)
concat_6 = Concatenate(FragmentA="Target", FragmentB=python_5.reward, JoinSeparator=" ")

concat_7 = Concatenate(FragmentA="Sunlight hours", FragmentB=python_5.reward, JoinSeparator=" ")
concat_8 = Concatenate(FragmentA=num, FragmentB="h", JoinSeparator=" ")
justified_text_6 = JustifiedText3d(
    Location=move_15.Geometry,
    Text=concat_8,
    Size=Slider(1.5, range=0..10),
    Color=ColourSwatch(SwatchColor=RGB(0, 0, 0)),
    HorizontalAlignment=1,
    VerticalAlginment=1,
    Font="Konnect",
    UseMeshes=False,
    Bake=False)

# ---- group: output
reward = Panel(python_5.reward)
observation = Panel(python_5.observation)

# ---- group: display (continued)
rectangle_5 = Rectangle(Plane=pt_4, XSize=num, YSize=number_slider_37, Radius=0)  # -> Rectangle, Length
gradient_2 = Gradient(LowerLimit="0", UpperLimit="15", Parameter=num, stops=[0.402: RGB(255, 99, 71), 0.526: RGB(128, 255, 128)])
boundary_4 = BoundarySurfaces(Edges=rectangle_5.Rectangle)
debrep_5 = DeconstructBrep(Brep=boundary_4)  # -> Faces, Edges, Vertices
preview_11 = CustomPreview(Geometry=debrep_5.Faces, Material=gradient_2)

concat_9 = Concatenate(FragmentA="reward", FragmentB=python_5.reward, JoinSeparator="=")
tag_6 = TextTag3D(
    Location=pt_7,
    Text=concat_9,
    Size=Slider(1.5, range=0..10),
    Colour=ColourSwatch(SwatchColor=RGB(0, 0, 0)),
    Justification=7)

justified_text_7 = JustifiedText3d(
    Location=pt_8,
    Text=python_5.observation,
    Size=number_slider_45,
    Color=ColourSwatch(SwatchColor=RGB(0, 0, 0)),
    HorizontalAlignment=1,
    VerticalAlginment=1,
    Font="Konnect",
    UseMeshes=False,
    Bake=False)

justified_text_8 = JustifiedText3d(
    Location=pt_11,
    Text=python_5.reward,
    Size=Slider(1.5, range=0..10),
    Color=ColourSwatch(SwatchColor=RGB(0, 0, 0)),
    HorizontalAlignment=1,
    VerticalAlginment=1,
    Font="Konnect",
    UseMeshes=False,
    Bake=False)

# ---- group: data visualization (continued)
sort = SortList(Keys=cull_2)  # -> Keys, ValuesA; disabled
cset_3 = CreateSet(List=sort.Keys)  # -> Set, Map; disabled
cset_4 = CreateSet(List=cset_3.Map)  # -> Set, Map; disabled
mindex_2 = MemberIndex(Set=cset_3.Map, Member=cset_4.Set)  # -> Index, Count; disabled
bnd_3 = Bounds(Numbers=mindex_2.Count)  # disabled

lng_3 = ListLength(List=sort.Keys)  # disabled
dom_4 = ConstructDomain(DomainStart=number_slider_29, DomainEnd=lng_3)  # disabled
num_2 = Number(expr("round(x,2)", division_11))  # disabled
num_3 = Number(expr("round(x,2)", pow_2))  # disabled
concat_10 = Concatenate(FragmentA=panel_12, FragmentB=num_3, JoinSeparator=" = ")  # disabled
concat_11 = Concatenate(FragmentA=panel_13, FragmentB=num, JoinSeparator=" = ")  # disabled

remap_5 = RemapNumbers(Value=mindex_2.Count, Source=dom_4, Target=dom_3)  # -> Mapped, Clipped; disabled

# ---- group: data visualization / display (continued)
tag_7 = TextTag3D(Location=move_21.Geometry, Text=concat_10, Size=number_slider_30, Colour=swatch_5, Justification=7)  # disabled

# ---- group: data visualization (continued)
multiplication_5 = Multiplication(A=rectangle_height, B=remap_5.Mapped)  # disabled
Y_21 = UnitY(Factor=multiplication_5)  # disabled
addition_12 = Addition(A=X_17, B=Y_21)  # disabled
item_12 = ListItem(List=move_16.Geometry, Index=cset_3.Set, Wrap=True)  # disabled
move_33 = Move(Geometry=item_12, Motion=addition_12)  # -> Geometry, Transform; disabled
item_13 = ListItem(List=move_16.Geometry, Index=cset_3.Set, Wrap=True)  # disabled

# ---- group: data visualization / display (continued)
concat_12 = Concatenate(FragmentA=panel_19, FragmentB=num_2, JoinSeparator=" = ")  # disabled
tag_8 = TextTag3D(Location=move_22.Geometry, Text=concat_12, Size=number_slider_34, Colour=swatch_6, Justification=7)  # disabled

tag_9 = TextTag3D(Location=move_23.Geometry, Text=concat_11, Size=number_slider_31, Colour=swatch_7, Justification=7)  # disabled

# ---- group: data visualization (continued)
rec_2pt = Rectangle2Pt(Plane=xy_8, PointA=move_33.Geometry, PointB=item_13, Radius=0)  # -> Rectangle, Length; disabled
crv_2 = Curve(rec_2pt.Rectangle)  # disabled
boundary_5 = BoundarySurfaces(Edges=crv_2)  # disabled

# ---- group: data visualization / display
preview_12 = CustomPreview(Geometry=flatten(boundary_5), Material=interp)

# ---- group: data visualization (continued)
pdecon_2 = Deconstruct(Point=directsunhours.points)  # -> XComponent, YComponent, ZComponent; disabled
larger_2 = LargerThan(FirstNumber=pdecon_2.ZComponent, SecondNumber=panel_10)  # -> LargerThan, OrEqualTo; disabled
dispatch = Dispatch(List=directsunhours.points, DispatchPattern=larger_2.LargerThan)  # -> ListA, ListB; disabled
pt_15 = Point(dispatch.ListB)  # disabled

lng_4 = ListLength(List=pt_15)  # disabled
multiplication_6 = Multiplication(A=lng_4, B=multiplication_3)  # disabled

division_12 = Division(A=multiplication_6, B=multiplication_4)  # disabled
subtraction_2 = Subtraction(A=panel_11, B=division_12)  # disabled
data_2 = Data(subtraction_2)  # disabled
